# Grasshopper definition kmeans.ghx (Grasshopper 0.9.76)
# plug-ins: Python Interpreter

pt = ConstructPoint(XCoordinate=Slider(0.736, range=0..1), YCoordinate=Slider(0.573, range=0..1), ZCoordinate=0)
pt_2 = ConstructPoint(XCoordinate=Slider(0.212, range=0..1), YCoordinate=Slider(0.32, range=0..1), ZCoordinate=0)
X = UnitX(Factor=pt_2)
Z = UnitZ(Factor=pt_2)
X_2 = UnitX(Factor=pt)
Z_2 = UnitZ(Factor=pt)
random = Random(Range=Domain(0.1, 0.25), Number=25, Seed=2)
random_2 = Random(Range=Domain(0, 360), Number=25, Seed=2)
amp = Amplitude(Vector=X, Amplitude=1)
random_3 = Random(Range=Domain(0.1, 0.25), Number=25, Seed=6)
random_4 = Random(Range=Domain(0, 360), Number=25, Seed=8)
amp_2 = Amplitude(Vector=X_2, Amplitude=1)
rad = Radians(Degrees=random_2)
rad_2 = Radians(Degrees=random_4)
vrot = Rotate(Vector=amp, Axis=Z, Angle=rad)
jitter = Jitter(List=vrot, Jitter=1, Seed=2)  # -> Values, Indices
amp_3 = Amplitude(Vector=jitter.Values, Amplitude=random)
vrot_2 = Rotate(Vector=amp_2, Axis=Z_2, Angle=rad_2)
jitter_2 = Jitter(List=vrot_2, Jitter=1, Seed=4)  # -> Values, Indices
amp_4 = Amplitude(Vector=jitter_2.Values, Amplitude=random_3)
move = Move(Geometry=pt, Motion=amp_4)  # -> Geometry, Transform
move_2 = Move(Geometry=pt_2, Motion=amp_3)  # -> Geometry, Transform
pt_3 = Point([move_2.Geometry, move.Geometry])
pdecon = Deconstruct(Point=pt_3)  # -> XComponent, YComponent, ZComponent
path = FilePath("C:\4.projects\ML\gh_data\main\kmeans.py")
rectangle = Rectangle(Plane=PlaneXY(0, 0, 0), XSize=Domain(0, 1), YSize=Domain(0, 1), Radius=0)  # -> Rectangle, Length
file = ReadFile(File=path, PerLineParse=False)
pop2d = Populate2D(Region=rectangle.Rectangle, Count=100, Seed=1)
kmeans = PythonScript(Code=file, Feat_1=pdecon.XComponent, Feat_2=pdecon.YComponent, C_num=Slider(2, range=0..10))  # -> Out, A, C_points, Labels, Centroids, Centr_labels, Centr
item = ListItem(List=kmeans.Out, Index=0, Wrap=True)  # -> Item, Item1, Item2, Item3, Item4, Item5
pt_4 = ConstructPoint(XCoordinate=Slider(0.25, range=0..1), YCoordinate=Slider(0.77, range=0..1), ZCoordinate=0)
pdecon_2 = Deconstruct(Point=pop2d)  # -> XComponent, YComponent, ZComponent
dist = Distance(PointA=pt_3, PointB=pt_4)
panel = Panel(kmeans.Out)
item_2 = ListItem(List=kmeans.Centr, Index=0, Wrap=True)  # -> Item, Item1
panel_2 = Panel(dist)
pt_5 = ConstructPoint(XCoordinate=item_2.Item, YCoordinate=item_2.Item1, ZCoordinate=0)
pt_6 = ConstructPoint(XCoordinate=item.Item3, YCoordinate=item.Item4, ZCoordinate=0)
pt_7 = ConstructPoint(XCoordinate=item.Item, YCoordinate=item.Item1, ZCoordinate=0)
rep = ReplaceText(Text=kmeans.C_points, Find="(", RecursiveReplace=False)
rep_2 = ReplaceText(Text=rep, Find=")", RecursiveReplace=False)
panel_3 = Panel(rep_2)
swatch = ColourSwatch(SwatchColor=RGB(94, 191, 255))
swatch_2 = ColourSwatch(SwatchColor=RGB(255, 56, 202))
pt_8 = Point(rep_2)
col = Colour([swatch, swatch_2])
item_3 = ListItem(List=col, Index=kmeans.Labels, Wrap=True)
dots = DotDisplay(Point=pt_3, Colour=swatch_2, Size=0.03)
dots_2 = DotDisplay(Point=pt_5, Colour=swatch, Size=0.03)
dots_3 = DotDisplay(Point=pt_8, Colour=item_3, Size=0.01)
dots_4 = DotDisplay(Point=pt_8, Colour=item_3, Size=0.01)
